# Grasshopper definition IPC_Srf Type B.gh (Grasshopper 1.0.7)
# plug-ins: Kangaroo2 Components, treesloth01, Pufferfish, Wombat

# ---- group: Division
number_slider = Slider(6, range=0..10)

# ---- group: Srf
brep = Brep(<brep referenced from the Rhino model>)

# ---- group: Double Diagonal
toggle = BooleanToggle(False)

# ---- group: Edge
number_slider_2 = Slider(0, range=0..1)

# ---- group: Diagonal #
number_slider_3 = Slider(0, range=0..1)

# ----
number_slider_4 = Slider(24, range=0..100)
direction_0_1 = GetInteger(AtLeast=1, AtMost=1, Maximum=2147483647, Minimum=-2147483648, TreeAccess=False)
double_diagonal = GetBoolean(AtLeast=1, AtMost=1, FalseValue="False", TreeAccess=False, TrueValue="True")
surface = GetGeometry(AtLeast=1, AtMost=1, DeleteInput=False, Filter=1074004029, TreeAccess=False)
division = GetInteger(AtLeast=1, AtMost=1, Maximum=2147483647, Minimum=-2147483648, TreeAccess=False)
diagonal_0_1 = GetInteger(AtLeast=1, AtMost=1, Maximum=2147483647, Minimum=-2147483648, TreeAccess=False)
edges = BrepEdges(Brep=surface)  # -> Naked, Interior, NonManifold
join = JoinCurves(Curves=edges.Naked, Preserve=False)
explode = Explode(Curve=join, Recursive=True)  # -> Segments, Vertices
item = ListItem(List=explode.Segments, Index=direction_0_1, Wrap=True)  # -> Item, Item1, Item2, Item3
flip = FlipCurve(Curve=item.Item2)  # -> Curve, Flag
merge = Merge(Data1=item.Item, Data2=flip.Curve)
divide = DivideCurve(Curve=merge, Count=division, Kinks=False)  # -> Points, Tangents, Parameters
flip_2 = FlipMatrix(Data=divide.Points)
pline = PolyLine(Vertices=flip_2, Closed=False)  # -> simplify(flatten(Polyline))
flip_3 = FlipCurve(Curve=pline)  # -> Curve, Flag
panel = Panel("""True
False""")
rev = ReverseList(List=pline)
panel_2 = Panel(panel)
filter = StreamFilter(Gate=diagonal_0_1, Stream0=flip_3.Curve, Stream1=pline)
shift = ShiftList(List=rev, Shift=Slider(0, range=0..1), Wrap=False)
dispatch = Dispatch(List=flatten(shift), DispatchPattern=panel_2)  # -> ListA, ListB
dispatch_2 = Dispatch(List=filter, DispatchPattern=panel)  # -> ListA, ListB
divide_2 = DivideCurve(Curve=dispatch_2.ListA, Count=division, Kinks=False)  # -> Points, Tangents, Parameters
divide_3 = DivideCurve(Curve=dispatch_2.ListB, Count=division, Kinks=False)  # -> Points, Tangents, Parameters
divide_4 = DivideCurve(Curve=dispatch.ListA, Count=division, Kinks=False)  # -> Points, Tangents, Parameters
divide_5 = DivideCurve(Curve=dispatch.ListB, Count=division, Kinks=False)  # -> Points, Tangents, Parameters
not = GateNot(A=panel)
not_2 = GateNot(A=panel_2)
dispatch_3 = Dispatch(List=divide_2.Points, DispatchPattern=panel)  # -> ListA, ListB
dispatch_4 = Dispatch(List=divide_3.Points, DispatchPattern=not)  # -> ListA, ListB
dispatch_5 = Dispatch(List=divide_4.Points, DispatchPattern=panel_2)  # -> ListA, ListB
dispatch_6 = Dispatch(List=divide_5.Points, DispatchPattern=not_2)  # -> ListA, ListB
pt = Point(dispatch_3.ListA)
pt_2 = Point(dispatch_4.ListA)
pt_3 = Point(dispatch_5.ListA)
pt_4 = Point(dispatch_6.ListA)
number_slider_5 = Slider(20000, range=0..100000)
number_slider_6 = Slider(20000, range=0..100000)
pline_2 = PolyLine(Vertices=pt_3, Closed=False)
pline_3 = PolyLine(Vertices=pt, Closed=False)
ext = ExtendCurve(Curve=pline_2, Type=0, Start=number_slider_5, End=number_slider_5)
ext_2 = ExtendCurve(Curve=pline_3, Type=0, Start=number_slider_6, End=number_slider_6)
filter_unmatched = FilterUnmatched(Data0=pt_3, Data1=pt_4)  # -> Data0, Data1
weave = Weave(Pattern=[0, 1], Stream0=filter_unmatched.Data0, Stream1=filter_unmatched.Data1, NullGaps=False)
context_print = ContextPrint(Text="20221006_IPC_Srf Type B_V2")

number_slider_7 = Slider(1, range=0..1)
flip_4 = FlipCurve(Curve=filter)  # -> Curve, Flag
division_2 = Division(A=division, B=number_slider_7)
divide_6 = DivideCurve(Curve=flip_4.Curve, Count=division, Kinks=False)  # -> Points, Tangents, Parameters
addition = Addition(A=division_2, B=number_slider_7)
flip_5 = FlipMatrix(Data=divide_6.Points)
series = Series(Start=0, Step=1, Count=addition)
pline_4 = PolyLine(Vertices=flip_5, Closed=False)
pline_5 = PolyLine(Vertices=divide_6.Points, Closed=False)
series_2 = Series(Start=0, Step=1, Count=series)
explode_2 = Explode(Curve=pline_5, Recursive=True)  # -> Segments, Vertices
explode_3 = Explode(Curve=pline_4, Recursive=True)  # -> Segments, Vertices
rev_2 = ReverseList(List=explode_2.Vertices)
lng = ListLength(List=series_2)
rev_3 = ReverseList(List=explode_3.Vertices)
addition_2 = Addition(A=lng, B=1)
cull_i = CullIndex(List=rev_3, Indices=series_2, Wrap=True)
cull_i_2 = CullIndex(List=explode_3.Vertices, Indices=series_2, Wrap=True)
rev_4 = ReverseList(List=flatten(addition_2))  # -> graft(List)
pline_6 = PolyLine(Vertices=cull_i, Closed=False)
pline_7 = PolyLine(Vertices=cull_i_2, Closed=False)
flip_6 = FlipCurve(Curve=pline_6)  # -> Curve, Flag
min = Minimum(A=addition_2, B=rev_4)
series_3 = Series(Start=0, Step=1, Count=division)
merge_2 = Merge(Data1=pline_7, Data2=flip_6.Curve)
series_4 = Series(Start=0, Step=1, Count=min)
explode_4 = Explode(Curve=merge_2, Recursive=True)  # -> Segments, Vertices
item_2 = ListItem(List=series_3, Index=series_4, Wrap=True)
shift_2 = ShiftPaths(Data=explode_4.Segments, Offset=-1)
item_3 = ListItem(List=rev_2, Index=item_2, Wrap=True)
dupln = RemoveDuplicateLines(Lines=shift_2, Tolerance=0.01)  # -> simplify(UniqueLines)
join_2 = JoinCurves(Curves=dupln, Preserve=False)
pline_8 = PolyLine(Vertices=item_3, Closed=False)

merge_3 = Merge(Data1=flatten(pt), Data2=flatten(pt_2))
end = EndPoints(Curve=join_2)  # -> Start, End
duppt = RemoveDuplicatePts(Points=merge_3, Tolerance=0.01)
ln = Line(StartPoint=end.Start, EndPoint=end.End)
crv_cp = CurveClosestPoint(Point=duppt, Curve=ln)  # -> Point, Parameter, Distance
smaller = SmallerThan(FirstNumber=crv_cp.Distance, SecondNumber=Slider(0.01, range=0..0.01))  # -> SmallerThan, OrEqualTo
dispatch_7 = Dispatch(List=crv_cp.Point, DispatchPattern=smaller.SmallerThan)  # -> ListA, ListB
crv_cp_2 = CurveClosestPoint(Point=dispatch_7.ListA, Curve=ln)  # -> Point, Parameter, Distance
shatter = Shatter(Curve=ln, Parameters=crv_cp_2.Parameter)
explode_5 = Explode(Curve=shatter, Recursive=True)  # -> Segments, Vertices
shift_3 = ShiftPaths(Data=explode_5.Segments, Offset=-1)
end_2 = EndPoints(Curve=shift_3)  # -> Start, End
ln_2 = Line(StartPoint=end_2.Start, EndPoint=end_2.End)

merge_4 = Merge(Data1=flatten(pt), Data2=flatten(pt_2))
end_3 = EndPoints(Curve=pline_8)  # -> Start, End
duppt_2 = RemoveDuplicatePts(Points=merge_4, Tolerance=0.01)
ln_3 = Line(StartPoint=end_3.Start, EndPoint=end_3.End)
crv_cp_3 = CurveClosestPoint(Point=duppt_2, Curve=ln_3)  # -> Point, Parameter, Distance
smaller_2 = SmallerThan(FirstNumber=crv_cp_3.Distance, SecondNumber=Slider(0.01, range=0..0.01))  # -> SmallerThan, OrEqualTo
dispatch_8 = Dispatch(List=crv_cp_3.Point, DispatchPattern=smaller_2.SmallerThan)  # -> ListA, ListB
crv_cp_4 = CurveClosestPoint(Point=dispatch_8.ListA, Curve=ln_3)  # -> Point, Parameter, Distance
shatter_2 = Shatter(Curve=ln_3, Parameters=crv_cp_4.Parameter)
explode_6 = Explode(Curve=shatter_2, Recursive=True)  # -> Segments, Vertices
shift_4 = ShiftPaths(Data=explode_6.Segments, Offset=-1)
end_4 = EndPoints(Curve=shift_4)  # -> Start, End
ln_4 = Line(StartPoint=end_4.Start, EndPoint=end_4.End)

crv = Curve(simplify(ln_2))
crv_2 = Curve(simplify(ln_4))
shift_5 = ShiftPaths(Data=crv, Offset=-1)
divide_branches = DivideBranches(DataTree=crv_2, DivisionPattern=[0, 1], RenumberPaths=False)  # -> Data0, Data1
divide_branches_2 = DivideBranches(DataTree=shift_5, DivisionPattern=[0, 1], RenumberPaths=False)  # -> Data0, Data1
crv_3 = Curve(divide_branches_2.Data0)
clean = CleanTree(RemoveNulls=True, RemoveInvalid=True, RemoveEmpty=True, Tree=crv_3)
item_4 = ListItem(List=divide_branches.Data1, Index=0, Wrap=True)
lastdex = LastIndex(List=divide_branches_2.Data1)
lng_2 = ListLength(List=flatten(lastdex))
dup = DuplicateData(Data=Slider(0, range=0..100), Number=lng_2, Order=True)  # -> simplify(graft(Data))
item_5 = ListItem(List=divide_branches_2.Data1, Index=0, Wrap=True)
match = MatchTree(Tree=dup, Guide=lastdex)
item_6 = ListItem(List=divide_branches_2.Data1, Index=lastdex, Wrap=True)
cull_i_3 = CullIndex(List=divide_branches_2.Data1, Indices=[lastdex, match], Wrap=False)
cull_i_4 = CullIndex(List=divide_branches.Data1, Indices=Slider(0, range=0..100), Wrap=True)
merge_5 = Merge(Data1=item_5, Data2=item_6, Data3=item_4)
merge_6 = Merge(Data1=divide_branches.Data0, Data2=cull_i_4, Data4=clean, Data5=cull_i_3)
group = Group(Objects=flatten(merge_5))
group_2 = Group(Objects=flatten(merge_6))

number_slider_8 = Slider(1, range=0..1)
division_3 = Division(A=division, B=number_slider_8)
divide_7 = DivideCurve(Curve=filter, Count=division, Kinks=False)  # -> Points, Tangents, Parameters
addition_3 = Addition(A=division_3, B=number_slider_8)
flip_7 = FlipMatrix(Data=divide_7.Points)
series_5 = Series(Start=0, Step=1, Count=addition_3)
pline_9 = PolyLine(Vertices=flip_7, Closed=False)
pline_10 = PolyLine(Vertices=divide_7.Points, Closed=False)
series_6 = Series(Start=0, Step=1, Count=series_5)
explode_7 = Explode(Curve=pline_10, Recursive=True)  # -> Segments, Vertices
explode_8 = Explode(Curve=pline_9, Recursive=True)  # -> Segments, Vertices
cull_i_5 = CullIndex(List=explode_7.Vertices, Indices=series_6, Wrap=True)
cull_i_6 = CullIndex(List=explode_8.Vertices, Indices=series_6, Wrap=True)
pline_11 = PolyLine(Vertices=cull_i_6, Closed=False)
pline_12 = PolyLine(Vertices=cull_i_5, Closed=False)
item_7 = ListItem(List=cull_i_5, Index=0, Wrap=True)  # -> Item1, Item
pline_13 = PolyLine(Vertices=flatten(item_7.Item1), Closed=False)
explode_9 = Explode(Curve=pline_13, Recursive=True)  # -> Segments, Vertices
null = NullObject()
filter_2 = StreamFilter(Gate=diagonal_0_1, Stream0=explode_9.Segments, Stream1=null)

merge_7 = Merge(Data1=flatten(pt), Data2=flatten(pt_2))
end_5 = EndPoints(Curve=pline_11)  # -> Start, End
duppt_3 = RemoveDuplicatePts(Points=merge_7, Tolerance=0.01)
ln_5 = Line(StartPoint=end_5.Start, EndPoint=end_5.End)
crv_cp_5 = CurveClosestPoint(Point=duppt_3, Curve=ln_5)  # -> Point, Parameter, Distance
smaller_3 = SmallerThan(FirstNumber=crv_cp_5.Distance, SecondNumber=Slider(0.01, range=0..0.01))  # -> SmallerThan, OrEqualTo
dispatch_9 = Dispatch(List=crv_cp_5.Point, DispatchPattern=smaller_3.SmallerThan)  # -> ListA, ListB
crv_cp_6 = CurveClosestPoint(Point=dispatch_9.ListA, Curve=ln_5)  # -> Point, Parameter, Distance
shatter_3 = Shatter(Curve=ln_5, Parameters=crv_cp_6.Parameter)
explode_10 = Explode(Curve=shatter_3, Recursive=True)  # -> Segments, Vertices
shift_6 = ShiftPaths(Data=explode_10.Segments, Offset=-1)
end_6 = EndPoints(Curve=shift_6)  # -> Start, End
ln_6 = Line(StartPoint=end_6.Start, EndPoint=end_6.End)

merge_8 = Merge(Data1=flatten(pt), Data2=flatten(pt_2))
end_7 = EndPoints(Curve=pline_12)  # -> Start, End
duppt_4 = RemoveDuplicatePts(Points=merge_8, Tolerance=0.01)
ln_7 = Line(StartPoint=end_7.Start, EndPoint=end_7.End)
crv_cp_7 = CurveClosestPoint(Point=duppt_4, Curve=ln_7)  # -> Point, Parameter, Distance
smaller_4 = SmallerThan(FirstNumber=crv_cp_7.Distance, SecondNumber=Slider(0.01, range=0..0.01))  # -> SmallerThan, OrEqualTo
dispatch_10 = Dispatch(List=crv_cp_7.Point, DispatchPattern=smaller_4.SmallerThan)  # -> ListA, ListB
crv_cp_8 = CurveClosestPoint(Point=dispatch_10.ListA, Curve=ln_7)  # -> Point, Parameter, Distance
shatter_4 = Shatter(Curve=ln_7, Parameters=crv_cp_8.Parameter)
explode_11 = Explode(Curve=shatter_4, Recursive=True)  # -> Segments, Vertices
shift_7 = ShiftPaths(Data=explode_11.Segments, Offset=-1)
end_8 = EndPoints(Curve=shift_7)  # -> Start, End
ln_8 = Line(StartPoint=end_8.Start, EndPoint=end_8.End)

crv_4 = Curve(simplify(ln_8))
crv_5 = Curve(simplify(ln_6))
divide_branches_3 = DivideBranches(DataTree=crv_4, DivisionPattern=[0, 1], RenumberPaths=False)  # -> Data0, Data1
divide_branches_4 = DivideBranches(DataTree=crv_5, DivisionPattern=[0, 1], RenumberPaths=False)  # -> Data0, Data1
lastdex_2 = LastIndex(List=divide_branches_3.Data1)
lastdex_3 = LastIndex(List=divide_branches_4.Data1)
item_8 = ListItem(List=divide_branches_4.Data1, Index=lastdex_3, Wrap=True)
cull_i_7 = CullIndex(List=divide_branches_4.Data1, Indices=lastdex_3, Wrap=True)
cull_i_8 = CullIndex(List=divide_branches_3.Data1, Indices=lastdex_2, Wrap=True)
item_9 = ListItem(List=divide_branches_3.Data1, Index=lastdex_2, Wrap=True)
merge_9 = Merge(Data1=item_9, Data2=item_8)
merge_10 = Merge(Data1=divide_branches_3.Data0, Data2=cull_i_8, Data3=filter_2, Data4=divide_branches_4.Data0, Data5=cull_i_7)
group_3 = Group(Objects=flatten(merge_9))
group_4 = Group(Objects=flatten(merge_10))

filter_3 = StreamFilter(Gate=double_diagonal, Stream0=group_4, Stream1=group_2)
filter_4 = StreamFilter(Gate=double_diagonal, Stream0=group_3, Stream1=group)
ungroup = Ungroup(Group=filter_4)
ungroup_2 = Ungroup(Group=filter_3)
context_bake = ContextBake(CrvType2=ungroup)

filter_unmatched_2 = FilterUnmatched(Data0=pt, Data1=pt_2)  # -> Data0, Data1
merge_11 = Merge(Data1=filter_unmatched_2.Data0, Data2=filter_unmatched_2.Data1)
merge_12 = Merge(Data1=filter_unmatched.Data0, Data2=filter_unmatched.Data1)
alongcrv = SortAlongCurve(Points=merge_11, Curve=ext_2)  # -> Points, Indices
alongcrv_2 = SortAlongCurve(Points=merge_12, Curve=ext)  # -> Points, Indices
pline_14 = PolyLine(Vertices=weave, Closed=False)
explode_12 = Explode(Curve=pline_14, Recursive=True)  # -> Segments, Vertices

weave_2 = Weave(Pattern=[0, 1], Stream0=filter_unmatched_2.Data0, Stream1=filter_unmatched_2.Data1, NullGaps=False)
points = PointList(Points=filter_unmatched_2.Data0, Size=Slider(500, range=0..1000))

pline_15 = PolyLine(Vertices=weave_2, Closed=False)
explode_13 = Explode(Curve=pline_15, Recursive=True)  # -> Segments, Vertices

merge_13 = Merge(Data1=explode_13.Segments, Data2=explode_12.Segments, Data3=ungroup_2)
dupln_2 = RemoveDuplicateLines(Lines=flatten(merge_13), Tolerance=0.01)
context_bake_2 = ContextBake(CrvType1=dupln_2)
