# Grasshopper definition Test Hops.gh (Grasshopper 1.0.7)

curve = GetGeometry(AtLeast=1, AtMost=1, DeleteInput=False, Filter=1074004029, TreeAccess=True)
height = GetNumber(AtLeast=1, AtMost=1, Maximum=1.797693135e+308, Minimum=-1.797693135e+308, TreeAccess=False)
crv = Curve(curve)
explode = Explode(Curve=crv, Recursive=True)  # -> Segments, Vertices
Z = UnitZ(Factor=height)
rev = Reverse(Vector=Z)
multiplication = Multiplication(A=Z, B=2)
move = Move(Geometry=explode.Segments, Motion=rev)  # -> Geometry, Transform
extr = Extrude(Base=move.Geometry, Direction=multiplication)
brep = Brep(extr)
context_bake = ContextBake(Extrusion=brep)
